# Grasshopper definition 220716_Brick_PA.ghx (Grasshopper 1.0.7)

geo = Geometry(<point referenced from the Rhino model>)
brick_positions = GhPythonScript(attractor=geo)  # -> out, brick_planes; inputs attractor: Point3d
# ---------- brick_positions: Python ----------
import Rhino.Geometry as rg
import math as m



"""Genrates a Rhino Geometry plane for each brick

This is where the design of the wall is created.

Returns
----------
brick_planes : [Rhino Geometry Plane, Rhino Geometry Plane, ...]

"""


VERTICAL_COUNT = 20
HORIZONTAL_COUNT = 10


BRICK_LENGTH = 12.5
BRICK_HEIGHT = 4

brick_planes = []

for i in range (VERTICAL_COUNT):
    for j in range (HORIZONTAL_COUNT):
        if i%2 ==0:
            x_pos = j * (BRICK_LENGTH + 1)
            rot = m.radians(10)
            
        else:
            x_pos = j * (BRICK_LENGTH + 1) + BRICK_LENGTH/2
            rot = m.radians(-10)
            
        z_pos = i * BRICK_HEIGHT
        
        origin = rg.Point3d(x_pos, 0, z_pos)
        
        plane = rg.Plane(origin, rg.Vector3d.XAxis, rg.Vector3d.YAxis)
        rg.Plane.Rotate(plane,rot, plane.ZAxis, plane.Origin)  #plane.Rotate(rot, plane.ZAxis, plane.Origin)
        brick_planes.append(plane)
# ---------- end brick_positions ----------
bricks = GhPythonScript(positions=brick_positions.brick_planes)  # -> out, brick_pts, brick_surfaces, brick_meshes; inputs positions: list of Plane
# ---------- bricks: Python ----------
import Rhino.Geometry as rg


def brick(plane):
    """ List of rg.Points definding the corners of the brick 
    
    Returns
    ----------
    [pt0 : bottom point at negative x and negative y,
    pt1 : bottom point at negative x and possitive y,
    pt2 : bottom point at possitive x and possitve y,
    pt3 : bottom point at possitive x and negative y,
    pt4 : pt0 + Thickness,
    pt5 : pt1 + Thickness,
    pt6 : pt2 + Thickness,
    pt7 : pt3 + Thickness]
    """
    
    LENGTH = 12.5 
    WIDTH = 6
    HEIGHT = 4
    
    origin = plane.Origin
    
    x_vec = plane.XAxis #rg.Plane.XAxis
    y_vec = plane.YAxis 
    z_vec = plane.ZAxis
    
    pt_0 = origin - (x_vec *LENGTH/2) - (y_vec*WIDTH/2)
    pt_1 = origin + (x_vec *LENGTH/2) - (y_vec*WIDTH/2)
    pt_2 = origin + (x_vec *LENGTH/2) + (y_vec*WIDTH/2)
    pt_3 = origin - (x_vec *LENGTH/2) + (y_vec*WIDTH/2)
    
    pt_4 = pt_0 + (z_vec*HEIGHT)
    pt_5 = pt_1 + (z_vec*HEIGHT)
    pt_6 = pt_2 + (z_vec*HEIGHT)
    pt_7 = pt_3 + (z_vec*HEIGHT)
    
    pts = [pt_0, pt_1, pt_2, pt_3, pt_4, pt_5, pt_6, pt_7]
    
    
    
    return pts


def surface(s_pts):
    """NURB surfaces depicting the brick:

    Returns
    ----------
    [srf0 : base surface,
    srf1 : long edge,
    srf2 : top surface
    srf3 : long edge,
    srf4 : short edge
    srf5 : short edge]
    """
    
    pt_0, pt_1, pt_2, pt_3, pt_4, pt_5, pt_6, pt_7 = s_pts 
    
    srf_0 = rg.NurbsSurface.CreateFromPoints([pt_0, pt_1, pt_3, pt_2], 2, 2, 1, 1)
    srf_1 = rg.NurbsSurface.CreateFromPoints([pt_0, pt_1, pt_4, pt_5], 2, 2, 1, 1)
    srf_2 = rg.NurbsSurface.CreateFromPoints([pt_4, pt_5, pt_7, pt_6], 2, 2, 1, 1)
    srf_3 = rg.NurbsSurface.CreateFromPoints([pt_2, pt_3, pt_6, pt_7], 2, 2, 1, 1)
    srf_4 = rg.NurbsSurface.CreateFromPoints([pt_0, pt_3, pt_4, pt_7], 2, 2, 1, 1)
    srf_5 = rg.NurbsSurface.CreateFromPoints([pt_1, pt_2, pt_5, pt_6], 2, 2, 1, 1)
    
    return srf_0, srf_1, srf_2, srf_3, srf_4, srf_5
    
    
def mesh(m_pts):
    """Mesh  depicting the brick:

    Returns
    ----------
    mesh_brick : Mesh
    """
    mesh_brick = rg.Mesh.CreateFromBox(m_pts, 1,1,1)
    return mesh_brick


brick_surfaces = []
brick_meshes = []

for pos in positions:

    brick_pts = brick(pos)
    #brick_surfaces.extend(surface(brick_pts))
    brick_meshes.append(mesh(brick_pts))
# ---------- end bricks ----------
