# Grasshopper definition 314_planning_scene.ghx (Grasshopper 1.0.7)

connect = BooleanToggle(False)
load_robot = BooleanToggle(False)
ros = ROSConnect(connect=connect)  # -> ros_client, is_connected; inputs port: Int32, connect: Boolean
#   port ip: The ip address ROS. Defaults to 127.0.0.1.
#   port port: The port of ROS. Defaults to 9090.
#   port connect: If True, connects to ROS. If False, disconnects from ROS. Defaults to False.
#   port ros_client: The ROS client.
#   port is_connected: True if connection established.
# ---------- ros: Python ----------
"""
Connect or disconnect to ROS.

COMPAS FAB v0.22.0
"""
from ghpythonlib.componentbase import executingcomponent as component
from scriptcontext import sticky as st

from compas_fab.backends import RosClient
from compas_fab.ghpython.components import create_id


class ROSConnect(component):
    def RunScript(self, ip, port, connect):
        ros_client = None

        ip = ip or '127.0.0.1'
        port = port or 9090

        key = create_id(self, 'ros_client')
        ros_client = st.get(key, None)

        if ros_client:
            st[key].close()
        if connect:
            st[key] = RosClient(ip, port)
            st[key].run(5)

        ros_client = st.get(key, None)
        is_connected = ros_client.is_connected if ros_client else False
        return (ros_client, is_connected)
# ---------- end ros ----------
robot = ROSRobot(ros_client=ros.ros_client, load=load_robot)  # -> robot; inputs load: Boolean
#   port ros_client: The ROS client.
#   port load: If True, loads the robot from ROS. Defaults to False.
# ---------- robot: Python ----------
"""
Load robot directly from ROS.

COMPAS FAB v0.22.0
"""
from compas_ghpython.artists import RobotModelArtist
from ghpythonlib.componentbase import executingcomponent as component
from scriptcontext import sticky as st

from compas_fab.ghpython.components import create_id


class ROSRobot(component):
    def RunScript(self, ros_client, load):
        key = create_id(self, 'robot')

        if ros_client and ros_client.is_connected and load:
            # Load URDF from ROS
            st[key] = ros_client.load_robot(load_geometry=True, precision='12f')
            st[key].artist = RobotModelArtist(st[key].model)

        robot = st.get(key, None)
        if robot:  # client sometimes need to be restarted, without needing to reload geometry
            robot.client = ros_client
        return robot
# ---------- end robot ----------

# ---- group: set config
# Configuration
a1 = Slider(0, range=-360..360)
a2 = Slider(0, range=-360..360)
a3 = Slider(0, range=-360..360)
a4 = Slider(0, range=-360..360)
a5 = Slider(0, range=-360..360)
a6 = Slider(0, range=-360..360)
config = PythonScript(vals=[a1, a2, a3, a4, a5, a6])  # -> config; inputs vals: list
# ---------- config: Python ----------
import math
from compas.robots import Configuration

config = Configuration.from_revolute_values([math.radians(a) for a in vals])
# ---------- end config ----------

# ----
robot_2 = Data(robot)
refresh = Button()
mesh = Mesh(<mesh referenced from the Rhino model>)
add_remove_meshes = GhPythonScript(robot=robot, mesh=mesh, name="box_1", add=Button(), remove=Button())  # -> out, a
# ---------- add_remove_meshes: Python ----------
from compas_rhino.conversions import RhinoMesh
from compas_fab.robots import PlanningScene
from compas_fab.robots import CollisionMesh

scene = PlanningScene(robot)

if mesh:
    m = RhinoMesh.from_guid(mesh).to_compas()
    cm = CollisionMesh(m, name)

if add:
    scene.add_collision_mesh(cm)
elif remove:
    scene.remove_collision_mesh(name)
# ---------- end add_remove_meshes ----------
robot_visualize = RobotVisualize(robot=robot_2, configuration=config, show_frames=True, show_acm=True)  # -> visual, collision, attached_meshes, frames, base_frame, ee_frame; inputs attached_collision_meshes: list, show_visual: Boolean, show_collision: Boolean, show_frames: Boolean, show_base_frame: Boolean, show_end_effector_frame: Boolean, show_acm: Boolean
#   port group: The planning group used for end-effector and base visualization.
#   port configuration: The robot's full configuration.
#   port attached_collision_meshes: A list of attached collision meshes.
#   port show_visual: Whether or not to show the robot's visual meshes.
#   port show_collision: Whether or not to show the robot's collision meshes.
#   port show_frames: Whether or not to show the robot's joint frames.
#   port show_base_frame: Whether or not to show the robot's base frame.
#   port show_end_effector_frame: Whether or not to show the robot's end-effector frame.
#   port show_acm: Whether or not to show the attached collision meshes (if any).
#   port visual: The robot's visual Rhino meshes (if any).
#   port collision: The robot's collision Rhino meshes (if any).
#   port attached_meshes: The attached collision Rhino meshes (if any).
#   port frames: The robot's joint frames as Rhino planes (if any).
#   port base_frame: The robot's base frame as a Rhino plane (if any).
#   port ee_frame: The robot's end-effector frame as a Rhino plane (if any).
# ---------- robot_visualize: Python ----------
"""
Visualizes the robot.

COMPAS FAB v0.22.0
"""
from compas.geometry import Frame
from compas.geometry import Transformation
from compas_ghpython.artists import FrameArtist
from compas_ghpython.artists import MeshArtist
from ghpythonlib.componentbase import executingcomponent as component


class RobotVisualize(component):
    def RunScript(self, robot, group, configuration, attached_collision_meshes, show_visual, show_collision,
                  show_frames, show_base_frame, show_end_effector_frame, show_acm):

        visual = None
        collision = None
        attached_meshes = None
        frames = None
        base_frame = None
        ee_frame = None

        if robot:
            show_visual = True if show_visual is None else show_visual
            configuration = configuration or robot.zero_configuration()

            robot.update(configuration, visual=show_visual, collision=show_collision)
            compas_frames = robot.transformed_frames(configuration, group)

            if show_visual:
                visual = robot.artist.draw_visual()

            if show_collision:
                collision = robot.artist.draw_collision()

            if show_base_frame:
                base_compas_frame = compas_frames[0]
                artist = FrameArtist(base_compas_frame)
                base_frame = artist.draw()

            if show_end_effector_frame:
                ee_compas_frame = robot.forward_kinematics(configuration, group, options=dict(solver='model'))
                artist = FrameArtist(ee_compas_frame)
                ee_frame = artist.draw()

            if show_frames:
                frames = []
                for compas_frame in compas_frames[1:]:
                    artist = FrameArtist(compas_frame)
                    frame = artist.draw()
                    frames.append(frame)

            if show_acm:
                attached_meshes = []
                for acm in attached_collision_meshes:
                    frame = robot.forward_kinematics(configuration, options=dict(solver='model', link_name=acm.link_name))
                    T = Transformation.from_frame_to_frame(Frame.worldXY(), frame)
                    mesh = acm.collision_mesh.mesh.transformed(T)
                    attached_meshes.append(MeshArtist(mesh).draw())

        return (visual, collision, attached_meshes, frames, base_frame, ee_frame)
# ---------- end robot_visualize ----------
planning_scene = GhPythonScript(robot=robot_2, refresh=refresh)  # -> a
# ---------- planning_scene: Python ----------
from compas_fab.robots import PlanningScene

from compas.artists import Artist
from compas.geometry import Frame
from compas.geometry import Transformation


scene = PlanningScene(robot)

collision_meshes = []
attached_collision_meshes = []

configuration = robot.zero_configuration()
scene = robot.client.get_planning_scene()

for co in scene.world.collision_objects:
    header = co.header
    frame_id = header.frame_id
    cms = co.to_collision_meshes()

    for cm in cms:
        if cm.frame != Frame.worldXY():
            t = Transformation.from_frame(cm.frame)
            mesh = cm.mesh.transformed(t)
        else:
            mesh = cm.mesh

        collision_meshes.append(mesh)

    for aco in scene.robot_state.attached_collision_objects:
        for acm in aco.to_attached_collision_meshes():
            frame_id = aco.object["header"]["frame_id"]
            frame = robot.forward_kinematics(configuration, options=dict(link=frame_id))
            t = Transformation.from_frame(frame)

            # Local CM frame
            if (acm.collision_mesh.frame and acm.collision_mesh.frame != Frame.worldXY()):
                t = t * Transformation.from_frame(acm.collision_mesh.frame)

            mesh = acm.collision_mesh.mesh.transformed(t)

            attached_collision_meshes.append(mesh)

a = []
for cm in collision_meshes + attached_collision_meshes:
    a.append(Artist(cm).draw_mesh())
# ---------- end planning_scene ----------
