# Grasshopper definition 401_brick_design_compas.ghx (Grasshopper 1.0.7)

geo = Geometry(<point referenced from the Rhino model>)
brick_positions = GhPythonScript(attractor=geo)  # -> out, brick_planes; inputs attractor: Point3d
# ---------- brick_positions: Python ----------
from compas.geometry import Frame, Point, Rotation
import math as m



"""Generates a COMPAS frames for each brick

This is where the design of the wall is created.

Returns
----------
brick_planes : [COMPAS Frame, COMPAS Frame, ...]

"""


VERTICAL_COUNT = 20
HORIZONTAL_COUNT = 10

# 0.031x0.016x0.0125

BRICK_LENGTH = 0.031
BRICK_HEIGHT = 0.016
GAP = 0.002

brick_planes = []

for i in range (VERTICAL_COUNT):
    for j in range (HORIZONTAL_COUNT):
        if i%2 ==0:
            x_pos = j * (BRICK_LENGTH + GAP)
            rot = m.radians(10)
            
        else:
            x_pos = j * (BRICK_LENGTH + GAP) + BRICK_LENGTH/2
            rot = m.radians(-10)
            
        z_pos = i * BRICK_HEIGHT
        
        origin = Point(x_pos, 0, z_pos)
        
        frame = Frame(origin, (1, 0, 0), (0, 1, 0))
        frame.transform(Rotation.from_axis_and_angle(frame.normal, rot, frame.point))
        brick_planes.append(frame)
# ---------- end brick_positions ----------
draw = Draw(cg=brick_positions.brick_planes)  # -> rg
#   port cg: The COMPAS geometry or datastructure to be drawn.
#   port rg: The Rhino geometry object.
# ---------- draw: Python ----------
"""
Draws COMPAS geometry in Grasshopper.
"""
from ghpythonlib.componentbase import executingcomponent as component

from compas.artists import Artist


class CompasToRhinoGeometry(component):
    def RunScript(self, cg):
        if not cg:
            return None

        return Artist(cg).draw()
# ---------- end draw ----------
bricks = GhPythonScript(positions=brick_positions.brick_planes)  # -> out, brick_pts, brick_surfaces, brick_meshes; inputs positions: list
# ---------- bricks: Python ----------
from compas.datastructures import Mesh
from compas.colors import Color
from compas.geometry import Box
import compas_ghpython

def brick(plane):
    """ List of points defining the corners of the brick 
    
    Returns
    ----------
    [pt0 : bottom point at negative x and negative y,
    pt1 : bottom point at negative x and possitive y,
    pt2 : bottom point at possitive x and possitve y,
    pt3 : bottom point at possitive x and negative y,
    pt4 : pt0 + Thickness,
    pt5 : pt1 + Thickness,
    pt6 : pt2 + Thickness,
    pt7 : pt3 + Thickness]
    """
    # 0.031x0.016x0.0125
    LENGTH = 0.031
    WIDTH = 0.0125 
    HEIGHT = 0.016
    
    origin = plane.point
    
    x_vec = plane.xaxis
    y_vec = plane.yaxis 
    z_vec = plane.normal

    pt_0 = origin - (x_vec *LENGTH/2) - (y_vec*WIDTH/2)
    pt_1 = origin + (x_vec *LENGTH/2) - (y_vec*WIDTH/2)
    pt_2 = origin + (x_vec *LENGTH/2) + (y_vec*WIDTH/2)
    pt_3 = origin - (x_vec *LENGTH/2) + (y_vec*WIDTH/2)
    
    pt_4 = pt_0 + (z_vec*HEIGHT)
    pt_5 = pt_1 + (z_vec*HEIGHT)
    pt_6 = pt_2 + (z_vec*HEIGHT)
    pt_7 = pt_3 + (z_vec*HEIGHT)
    
    pts = [pt_0, pt_1, pt_2, pt_3, pt_4, pt_5, pt_6, pt_7]
    
    
    
    return pts

    
def mesh(m_pts):
    """Mesh  depicting the brick:

    Returns
    ----------
    mesh_brick : Mesh
    """
    box = Box.from_bounding_box(m_pts)
    mesh_brick = Mesh.from_shape(box)
    return mesh_brick


brick_meshes = []
brick_frames = positions

for pos in positions:
    brick_pts = brick(pos)
    brick_mesh = mesh(brick_pts)

    vertices, faces = brick_mesh.to_vertices_and_faces()
    brick_meshes.append(compas_ghpython.draw_mesh(vertices, faces, color=Color(0.9, 0.3, .2, .5).rgba255))
# ---------- end bricks ----------
