# Grasshopper definition 502_control.ghx (Grasshopper 1.0.7)

# ----
# Robot
load = Button()
python = PythonScript(load=load)  # -> model, artist
# ---------- python: Python ----------
from scriptcontext import sticky as st
import os
import compas

from compas.robots import RobotModel
from compas.robots import LocalPackageMeshLoader
from compas.artists import Artist

# Store robot in component-based key
model_key = 'model_{}'.format(str(ghenv.Component.InstanceGuid))
artist_key = 'artist_{}'.format(str(ghenv.Component.InstanceGuid))

ghfile = ghenv.Component.OnPingDocument().FilePath
DATA = os.path.abspath(os.path.join(os.path.dirname(ghfile), '..', 'data'))

if model_key not in st:
    st[model_key] = None
if artist_key not in st:
    st[artist_key] = None

if load:
    model = RobotModel.from_urdf_file(os.path.join(DATA, 'ur10e.urdf'))
    loader = LocalPackageMeshLoader(DATA, 'ur_description')
    model.load_geometry(loader)

    artist = Artist(model)

    st[model_key] = model
    st[artist_key] = artist

model = st[model_key]
artist = st[artist_key]
# ---------- end python ----------

# ---- group: set config
# Configuration
pt = Point(Point(0.691309085, 0.05260285023, 0.401755888))
xz = XZPlane(Origin=pt)
python_2 = GhPythonScript(plane=xz)  # -> configurations
# ---------- python_2: Python ----------
from compas.geometry import Frame
from compas.robots import Configuration
from compas_fab.backends.kinematics.solvers import OffsetWristKinematics

UR10eKinematics = OffsetWristKinematics([0.1807, -0.6127, -0.57155, 0.17415, 0.11985, 0.11655])

f = Frame(plane.Origin, plane.XAxis, plane.ZAxis)

configurations = []
for jv in UR10eKinematics.inverse(f):
    configurations.append(Configuration.from_revolute_values(jv))
# ---------- end python_2 ----------
item = ListItem(List=python_2, Index=Slider(1, range=0..7), Wrap=True)

# ----
# Visualisation
visualize = GhPythonScript(model=python.model, artist=python.artist, config=item)  # -> out, a
# ---------- visualize: Python ----------
jv = config.joint_values

config = model.zero_configuration()
config.joint_values = jv

artist.update(config)
a = artist.draw()
# ---------- end visualize ----------

# ----
# Control
number_slider = Slider(0.5, range=0..2)
get_config = GhPythonScript(send=Button())  # -> config
# ---------- get_config: Python ----------
import os
from scriptcontext import sticky as st
from compas.rpc import Proxy

config_key = 'config_{}'.format(str(ghenv.Component.InstanceGuid))
if config_key not in st:
    st[config_key] = None

if send:
    ghfile = ghenv.Component.OnPingDocument().FilePath
    rtde = Proxy('510_rtde', path=os.path.dirname(ghfile))
    
    st[config_key] = rtde.get_config()

config = st[config_key]
# ---------- end get_config ----------
send_configs = GhPythonScript(speed=number_slider, accel=Slider(1.56, range=0..3.14), send=Button())  # -> out, a; inputs configs: list
# ---------- send_configs: Python ----------
import os
from compas.rpc import Proxy

if send:
    ghfile = ghenv.Component.OnPingDocument().FilePath
    rtde = Proxy('510_rtde', path=os.path.dirname(ghfile))
    nowait = False
    a = rtde.send_trajectory(configs, speed, accel, nowait)
# ---------- end send_configs ----------
move_to_config = GhPythonScript(config=item, speed=Slider(0.5, range=0..2), accel=Slider(1.56, range=0..3.14), send=Button())  # -> out, a
# ---------- move_to_config: Python ----------
import os
from compas.rpc import Proxy

if send:
    ghfile = ghenv.Component.OnPingDocument().FilePath
    rtde = Proxy('510_rtde', path=os.path.dirname(ghfile))
    nowait = False
    a = rtde.move_to_joints(config, speed, accel, nowait)
# ---------- end move_to_config ----------
set_io = GhPythonScript(signal=Slider(1, range=0..20), value=Toggle(True), send=Button())  # -> out, a
# ---------- set_io: Python ----------
import os
from compas.rpc import Proxy

if send:
    ghfile = ghenv.Component.OnPingDocument().FilePath
    rtde = Proxy('510_rtde', path=os.path.dirname(ghfile))
    a = rtde.set_digital_io(int(signal), value)
# ---------- end set_io ----------
get_io = GhPythonScript(signal=Slider(1, range=0..20), send=Button())  # -> out, a
# ---------- get_io: Python ----------
import os
from scriptcontext import sticky as st
from compas.rpc import Proxy

io_key = 'io_{}'.format(str(ghenv.Component.InstanceGuid))
if io_key not in st:
    st[io_key] = None

if send:
    ghfile = ghenv.Component.OnPingDocument().FilePath
    rtde = Proxy('510_rtde', path=os.path.dirname(ghfile))
    st[io_key] = rtde.get_digital_io(int(signal))

a = st[io_key]
# ---------- end get_io ----------
panel = Panel(get_config)

panel_2 = Panel(get_io.a)
