# Grasshopper definition 503_fab_design_2.ghx (Grasshopper 1.0.7)

python = GhPythonScript()  # -> out, a; disabled
# ---------- python: Python ----------
import math
a = -5.3587 + math.radians(90)
print a
# ---------- end python ----------
number_slider = Slider(0.144, range=-3.14..3.14)  # disabled
number_slider_2 = Slider(-1.042, range=-3.14..3.14)  # disabled
number_slider_3 = Slider(2.102, range=-3.14..3.14)  # disabled
number_slider_4 = Slider(-2.616, range=-3.14..3.14)  # disabled
number_slider_5 = Slider(-1.564, range=-3.14..3.14)  # disabled
number_slider_6 = Slider(-3.7, range=-7..7)  # disabled
p1 = GhPythonScript()  # -> out, a
# ---------- p1: Python ----------
import math
from compas.geometry import Frame
from compas.geometry import Rotation
from compas.artists import Artist

origin = [-0.6928788490382566, -0.2797831683004097, 0.0027335926009166567]
rot = [2.221463377870279, 2.2213985444339217, 1.5210904793063424e-05]

f = Frame.from_transformation(Rotation.from_axis_angle_vector(rot))
f.point = origin

f = f.transformed(Rotation.from_axis_and_angle((0, 0, 1), math.radians(180)))
a = Artist(f).draw()
# ---------- end p1 ----------
p2 = GhPythonScript()  # -> out, a
# ---------- p2: Python ----------
import math
from compas.geometry import Frame
from compas.geometry import Rotation
from compas.artists import Artist

origin = [-0.41096820178872223, 0.004657815595240383, 0.0027217294305760392]
rot = [-1.4104539107852703, 2.8071610024737947, -7.393879865960283e-05]

f = Frame.from_transformation(Rotation.from_axis_angle_vector(rot))
f.point = origin

f = f.transformed(Rotation.from_axis_and_angle((0, 0, 1), math.radians(180)))
a = Artist(f).draw()
# ---------- end p2 ----------
python_2 = GhPythonScript(x=p1.a, y=p2.a)  # -> out, a
# ---------- python_2: Python ----------
import Rhino.Geometry as rg

#l = rg.Line(x.Origin, y.Origin)
xaxis = y.Origin - x.Origin
print xaxis
yaxis = rg.Vector3d.CrossProduct(xaxis, rg.Vector3d.ZAxis)
print y

from compas.geometry import Frame
origin = [0.677392135561601,0.276959121779559,0.0162607614012409]
a = rg.Plane(rg.Point3d(*origin), xaxis, yaxis)
# ---------- end python_2 ----------
p2_2 = GhPythonScript()  # -> out, a
# ---------- p2_2: Python ----------
import math
from compas.geometry import Frame
from compas.geometry import Rotation
from compas.artists import Artist

origin = [-0.6773921355616007, -0.2769591217795594, 0.016260761401240886]
rot = [-1.4104539107852703, 2.8071610024737947, -7.393879865960283e-05]

f = Frame.from_transformation(Rotation.from_axis_angle_vector(rot))
f.point = origin

f = f.transformed(Rotation.from_axis_and_angle((0, 0, 1), math.radians(180)))
a = Artist(f).draw()
print a
# ---------- end p2_2 ----------
python_3 = GhPythonScript()  # -> out, brick_planes
# ---------- python_3: Python ----------
from compas.geometry import Frame

BRICK_LENGTH = 0.031
BRICK_WIDTH = 0.0125
BRICK_HEIGHT = 0.016
GAP = 0.002

length=BRICK_LENGTH
height=BRICK_HEIGHT
width = BRICK_WIDTH

brick_planes = []



num_bricks_even = 3
num_bricks_uneven = 7

full_length = num_bricks_even * BRICK_LENGTH + (num_bricks_even - 1) * GAP

for i in range (10):
    if i % 2 == 0: 
        
        GAP = 0.002
    
        for j in range (num_bricks_even):
    
            brick_x = j*(length + GAP) + length/2
            brick_z = height*i
            frame = Frame((brick_x, 0, brick_z), (1,0,0), (0,1,0))
            brick_planes.append(frame)
    else:
        
        GAP_UNEVEN = (full_length - num_bricks_uneven * BRICK_WIDTH)/(num_bricks_uneven - 1)
        
        for j in range (7):
    
            brick_x = j*(width + GAP_UNEVEN) + width/2
            brick_z = height*i
            frame = Frame((brick_x, 0, brick_z), (0,1,0), (-1,0,0))
            brick_planes.append(frame)
        
            

print brick_planes
# ---------- end python_3 ----------

# ----
# Design
number_slider_7 = Slider(2.89, range=-3.14..3.14)
pt = Point(Point(0.4092773506, 0.4391997545, 0.005223249163))
xy = XYPlane(Origin=pt)
brick_positions = GhPythonScript()  # -> out, brick_planes; inputs attractor: Point3d
# ---------- brick_positions: Python ----------
from compas.geometry import Frame, Point, Rotation
import math as m



"""Generates a COMPAS frames for each brick

This is where the design of the wall is created.

Returns
----------
brick_planes : [COMPAS Frame, COMPAS Frame, ...]

"""


VERTICAL_COUNT = 10
HORIZONTAL_COUNT = 5

# 0.031x0.016x0.0125

BRICK_LENGTH = 0.031
BRICK_HEIGHT = 0.016
GAP = 0.002

brick_planes = []

for i in range (VERTICAL_COUNT):
    for j in range (HORIZONTAL_COUNT):
        if i%2 ==0:
            x_pos = j * (BRICK_LENGTH + GAP)
            rot = m.radians(10)
            
        else:
            x_pos = j * (BRICK_LENGTH + GAP) + BRICK_LENGTH/2
            rot = m.radians(-10)
            
        z_pos = i * BRICK_HEIGHT
        
        origin = Point(x_pos, 0, z_pos)
        
        frame = Frame(origin, (1, 0, 0), (0, 1, 0))
        frame.transform(Rotation.from_axis_and_angle(frame.normal, rot, frame.point))
        brick_planes.append(frame)
# ---------- end brick_positions ----------
prot = RotatePlane(Plane=xy, Angle=number_slider_7)
transform = GhPythonScript(brick_plane=python_3.brick_planes, target=prot)  # -> target_frame
# ---------- transform: Python ----------
from compas.geometry import Frame, Transformation
from compas_rhino.conversions import RhinoPlane

f = RhinoPlane.from_geometry(target).to_compas_frame()
T = Transformation.from_frame(f)

target_frame = brick_plane.transformed(T)
# ---------- end transform ----------
bricks = GhPythonScript(positions=transform)  # -> out, brick_pts, brick_surfaces, brick_meshes; inputs positions: list
# ---------- bricks: Python ----------
from compas.datastructures import Mesh
from compas.colors import Color
from compas.geometry import Box
import compas_ghpython

def brick(plane):
    """ List of points defining the corners of the brick 
    
    Returns
    ----------
    [pt0 : bottom point at negative x and negative y,
    pt1 : bottom point at negative x and possitive y,
    pt2 : bottom point at possitive x and possitve y,
    pt3 : bottom point at possitive x and negative y,
    pt4 : pt0 + Thickness,
    pt5 : pt1 + Thickness,
    pt6 : pt2 + Thickness,
    pt7 : pt3 + Thickness]
    """
    # 0.031x0.016x0.0125
    LENGTH = 0.031
    WIDTH = 0.0125 
    HEIGHT = 0.016
    
    origin = plane.point
    
    x_vec = plane.xaxis
    y_vec = plane.yaxis 
    z_vec = plane.normal

    pt_0 = origin - (x_vec *LENGTH/2) - (y_vec*WIDTH/2)
    pt_1 = origin + (x_vec *LENGTH/2) - (y_vec*WIDTH/2)
    pt_2 = origin + (x_vec *LENGTH/2) + (y_vec*WIDTH/2)
    pt_3 = origin - (x_vec *LENGTH/2) + (y_vec*WIDTH/2)
    
    pt_4 = pt_0 + (z_vec*HEIGHT)
    pt_5 = pt_1 + (z_vec*HEIGHT)
    pt_6 = pt_2 + (z_vec*HEIGHT)
    pt_7 = pt_3 + (z_vec*HEIGHT)
    
    pts = [pt_0, pt_1, pt_2, pt_3, pt_4, pt_5, pt_6, pt_7]
    
    
    
    return pts

    
def mesh(m_pts):
    """Mesh  depicting the brick:

    Returns
    ----------
    mesh_brick : Mesh
    """
    box = Box.from_bounding_box(m_pts)
    mesh_brick = Mesh.from_shape(box)
    return mesh_brick


brick_meshes = []
brick_frames = positions

for pos in positions:
    brick_pts = brick(pos)
    brick_mesh = mesh(brick_pts)

    vertices, faces = brick_mesh.to_vertices_and_faces()
    brick_meshes.append(compas_ghpython.draw_mesh(vertices, faces, color=Color(0.9, 0.3, .2, .5).rgba255))
# ---------- end bricks ----------
draw = Draw(cg=transform)  # -> rg
#   port cg: The COMPAS geometry or datastructure to be drawn.
#   port rg: The Rhino geometry object.
# ---------- draw: Python ----------
"""
Draws COMPAS geometry in Grasshopper.
"""
from ghpythonlib.componentbase import executingcomponent as component

from compas.artists import Artist


class CompasToRhinoGeometry(component):
    def RunScript(self, cg):
        if not cg:
            return None

        return Artist(cg).draw()
# ---------- end draw ----------

# ----
# Connect
connect = BooleanToggle(True)
load_robot = BooleanToggle(True)
ros = ROSConnect(connect=connect)  # -> ros_client, is_connected; inputs port: Int32, connect: Boolean
#   port ip: The ip address ROS. Defaults to 127.0.0.1.
#   port port: The port of ROS. Defaults to 9090.
#   port connect: If True, connects to ROS. If False, disconnects from ROS. Defaults to False.
#   port ros_client: The ROS client.
#   port is_connected: True if connection established.
# ---------- ros: Python ----------
"""
Connect or disconnect to ROS.

COMPAS FAB v0.22.0
"""
from ghpythonlib.componentbase import executingcomponent as component
from scriptcontext import sticky as st

from compas_fab.backends import RosClient
from compas_fab.ghpython.components import create_id


class ROSConnect(component):
    def RunScript(self, ip, port, connect):
        ros_client = None

        ip = ip or '127.0.0.1'
        port = port or 9090

        key = create_id(self, 'ros_client')
        ros_client = st.get(key, None)

        if ros_client:
            st[key].close()
        if connect:
            st[key] = RosClient(ip, port)
            st[key].run(5)

        ros_client = st.get(key, None)
        is_connected = ros_client.is_connected if ros_client else False
        return (ros_client, is_connected)
# ---------- end ros ----------
robot = ROSRobot(ros_client=ros.ros_client, load=load_robot)  # -> robot; inputs load: Boolean
#   port ros_client: The ROS client.
#   port load: If True, loads the robot from ROS. Defaults to False.
# ---------- robot: Python ----------
"""
Load robot directly from ROS.

COMPAS FAB v0.22.0
"""
from compas_ghpython.artists import RobotModelArtist
from ghpythonlib.componentbase import executingcomponent as component
from scriptcontext import sticky as st

from compas_fab.ghpython.components import create_id


class ROSRobot(component):
    def RunScript(self, ros_client, load):
        key = create_id(self, 'robot')

        if ros_client and ros_client.is_connected and load:
            # Load URDF from ROS
            st[key] = ros_client.load_robot(load_geometry=True, precision='12f')
            st[key].artist = RobotModelArtist(st[key].model)

        robot = st.get(key, None)
        if robot:  # client sometimes need to be restarted, without needing to reload geometry
            robot.client = ros_client
        return robot
# ---------- end robot ----------
robot_2 = Data(robot)

# ---- group: set config
# Pick up
number_slider_8 = Slider(0.1455, range=-3.14..3.14)
pickup = GhPythonScript(
    model=robot,
    jv=[number_slider_8, Slider(-1.0402, range=-3.14..3.14), Slider(2.1027, range=-3.14..3.14), Slider(-2.6332, range=-3.14..3.14), Slider(-1.5706, range=-3.14..3.14), Slider(-3.786, range=-7..7)])  # -> config; inputs jv: list
# ---------- pickup: Python ----------
config = model.zero_configuration()
config.joint_values = jv
# ---------- end pickup ----------

# ----
# Approach pickup
fk = GhPythonScript(model=robot_2, config=pickup)  # -> out, frame
# ---------- fk: Python ----------
frame = model.forward_kinematics(config)
print frame
# ---------- end fk ----------
draw_2 = Draw(cg=fk.frame)  # -> rg; same code as draw
move = Move(Geometry=draw_2, Motion=Vector(0, 0, 0.15))  # -> Geometry, Transform
ik = InverseKinematics(robot=robot, plane=move.Geometry, start_configuration=pickup)  # -> configuration
#   port plane: The plane or frame to calculate the inverse kinematic for.
#   port start_configuration: If passed, calculates the inverse such that the joint positions differ the least from the start_configuration. Defaults to the zero configuration.
#   port group: The planning group used for calculation. Defaults to the robot's main planning group.
#   port configuration: The planning group's configuration.
# ---------- ik: Python ----------
"""
Calculate the robot's inverse kinematic for a given plane.

COMPAS FAB v0.26.0
"""
from compas_rhino.conversions import RhinoPlane
from ghpythonlib.componentbase import executingcomponent as component


class InverseKinematics(component):
    def RunScript(self, robot, plane, start_configuration, group):
        configuration = None
        if robot and robot.client and robot.client.is_connected and plane:
            frame = RhinoPlane.from_geometry(plane).to_compas_frame()
            configuration = robot.inverse_kinematics(frame, start_configuration, group)
        return configuration
# ---------- end ik ----------

vec = VectorXYZ(XComponent=0, YComponent=0, ZComponent=Slider(0.09, range=0..0.1))  # -> Vector, Length
move_2 = Move(Geometry=python_2.a, Motion=vec.Vector)  # -> Geometry, Transform
ik_2 = InverseKinematics(robot=robot, plane=move_2.Geometry, start_configuration=ik)  # -> configuration; same code as ik

# ----
# Planning scene
plate = Mesh(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)
refresh = Button()
mesh = Mesh(<mesh referenced from the Rhino model>)
add_remove_meshes = GhPythonScript(robot=robot, mesh=mesh, name="box_1", add=Button(), remove=Button())  # -> out, a
# ---------- add_remove_meshes: Python ----------
from compas_rhino.conversions import RhinoMesh
from compas_fab.robots import PlanningScene
from compas_fab.robots import CollisionMesh

scene = PlanningScene(robot)

if mesh:
    m = RhinoMesh.from_guid(mesh).to_compas()
    cm = CollisionMesh(m, name)

if add:
    scene.add_collision_mesh(cm)
elif remove:
    scene.remove_collision_mesh(name)
# ---------- end add_remove_meshes ----------
planning_scene = GhPythonScript(robot=robot_2, refresh=refresh)  # -> a
# ---------- planning_scene: Python ----------
from compas_fab.robots import PlanningScene

from compas.artists import Artist
from compas.geometry import Frame
from compas.geometry import Transformation


scene = PlanningScene(robot)

collision_meshes = []
attached_collision_meshes = []

configuration = robot.zero_configuration()
scene = robot.client.get_planning_scene()

for co in scene.world.collision_objects:
    header = co.header
    frame_id = header.frame_id
    cms = co.to_collision_meshes()

    for cm in cms:
        if cm.frame != Frame.worldXY():
            t = Transformation.from_frame(cm.frame)
            mesh = cm.mesh.transformed(t)
        else:
            mesh = cm.mesh

        collision_meshes.append(mesh)

    for aco in scene.robot_state.attached_collision_objects:
        for acm in aco.to_attached_collision_meshes():
            frame_id = aco.object["header"]["frame_id"]
            frame = robot.forward_kinematics(configuration, options=dict(link=frame_id))
            t = Transformation.from_frame(frame)

            # Local CM frame
            if (acm.collision_mesh.frame and acm.collision_mesh.frame != Frame.worldXY()):
                t = t * Transformation.from_frame(acm.collision_mesh.frame)

            mesh = acm.collision_mesh.mesh.transformed(t)

            attached_collision_meshes.append(mesh)

a = []
for cm in collision_meshes + attached_collision_meshes:
    a.append(Artist(cm).draw_mesh())
# ---------- end planning_scene ----------

list = ValueList({"Pickup config": 0, "Approach pickup config": 1, "Current config": 2, "Current brick": 3, "Approach current brick": 4}, selected="Approach current brick")

# ----
# Approach place
number_slider_9 = Slider(0.15, range=0..0.2)
vec_2 = VectorXYZ(XComponent=0, YComponent=0, ZComponent=number_slider_9)  # -> Vector, Length

# ----
# Place
number_slider_10 = Slider(0.09, range=0..0.1)
vec_3 = VectorXYZ(XComponent=0, YComponent=0, ZComponent=number_slider_10)  # -> Vector, Length

# ----
# Control
number_slider_11 = Slider(0, range=0..20)
get_config = GhPythonScript(send=Button(), ip="192.168.0.10")  # -> config
# ---------- get_config: Python ----------
import os
from scriptcontext import sticky as st
from compas.rpc import Proxy

config_key = 'config_{}'.format(str(ghenv.Component.InstanceGuid))
if config_key not in st:
    st[config_key] = None

if send:
    ghfile = ghenv.Component.OnPingDocument().FilePath
    rtde = Proxy('510_rtde', path=os.path.dirname(ghfile))
    
    st[config_key] = rtde.get_config(ip=ip)

config = st[config_key]
# ---------- end get_config ----------
set_io = GhPythonScript(signal=number_slider_11, value=Toggle(False), send=Button(), ip="192.168.0.10")  # -> out, a
# ---------- set_io: Python ----------
import os
from compas.rpc import Proxy

if send:
    ghfile = ghenv.Component.OnPingDocument().FilePath
    rtde = Proxy('510_rtde', path=os.path.dirname(ghfile))
    a = rtde.set_digital_io(int(signal), value, ip=ip)
# ---------- end set_io ----------
get_io = GhPythonScript(signal=Slider(1, range=0..20), send=Button(), ip="192.168.0.10")  # -> out, a
# ---------- get_io: Python ----------
import os
from scriptcontext import sticky as st
from compas.rpc import Proxy

io_key = 'io_{}'.format(str(ghenv.Component.InstanceGuid))
if io_key not in st:
    st[io_key] = None

if send:
    ghfile = ghenv.Component.OnPingDocument().FilePath
    rtde = Proxy('510_rtde', path=os.path.dirname(ghfile))
    st[io_key] = rtde.get_digital_io(int(signal), ip=ip)

a = st[io_key]
# ---------- end get_io ----------
panel = Panel(get_io.a)
panel_2 = Panel(get_config)

# ----
# Pick and Place
# 1. Select brick number
# 2. Click send to pick and place it
number_slider_12 = Slider(3, range=0..6)
item = ListItem(List=transform, Index=Slider(49, range=0..200), Wrap=True)
draw_3 = Draw(cg=item)  # -> rg; same code as draw

pflip = FlipPlane(Plane=draw_3, ReverseX=False, ReverseY=False, SwapAxes=True)
move_3 = Move(Geometry=pflip, Motion=vec_3.Vector)  # -> Geometry, Transform
ik_3 = InverseKinematics(robot=robot, plane=move_3.Geometry, start_configuration=ik)  # -> configuration; same code as ik

move_4 = Move(Geometry=move_3.Geometry, Motion=vec_2.Vector)  # -> Geometry, Transform
ik_4 = InverseKinematics(robot=robot, plane=move_4.Geometry, start_configuration=ik)  # -> configuration; same code as ik

filter = StreamFilter(Gate=list, Stream0=pickup, Stream1=ik, Stream2=get_config, Stream3=ik_3, Stream4=ik_4)

# ----
# Visualization
config = Data(filter)
robot_visualize = RobotVisualize(robot=robot_2, configuration=config, show_frames=True, show_acm=True)  # -> visual, collision, attached_meshes, frames, base_frame, ee_frame; inputs attached_collision_meshes: list, show_visual: Boolean, show_collision: Boolean, show_frames: Boolean, show_base_frame: Boolean, show_end_effector_frame: Boolean, show_acm: Boolean
#   port group: The planning group used for end-effector and base visualization.
#   port configuration: The robot's full configuration.
#   port attached_collision_meshes: A list of attached collision meshes.
#   port show_visual: Whether or not to show the robot's visual meshes.
#   port show_collision: Whether or not to show the robot's collision meshes.
#   port show_frames: Whether or not to show the robot's joint frames.
#   port show_base_frame: Whether or not to show the robot's base frame.
#   port show_end_effector_frame: Whether or not to show the robot's end-effector frame.
#   port show_acm: Whether or not to show the attached collision meshes (if any).
#   port visual: The robot's visual Rhino meshes (if any).
#   port collision: The robot's collision Rhino meshes (if any).
#   port attached_meshes: The attached collision Rhino meshes (if any).
#   port frames: The robot's joint frames as Rhino planes (if any).
#   port base_frame: The robot's base frame as a Rhino plane (if any).
#   port ee_frame: The robot's end-effector frame as a Rhino plane (if any).
# ---------- robot_visualize: Python ----------
"""
Visualizes the robot.

COMPAS FAB v0.22.0
"""
from compas.geometry import Frame
from compas.geometry import Transformation
from compas_ghpython.artists import FrameArtist
from compas_ghpython.artists import MeshArtist
from ghpythonlib.componentbase import executingcomponent as component


class RobotVisualize(component):
    def RunScript(self, robot, group, configuration, attached_collision_meshes, show_visual, show_collision,
                  show_frames, show_base_frame, show_end_effector_frame, show_acm):

        visual = None
        collision = None
        attached_meshes = None
        frames = None
        base_frame = None
        ee_frame = None

        if robot:
            show_visual = True if show_visual is None else show_visual
            configuration = configuration or robot.zero_configuration()

            robot.update(configuration, visual=show_visual, collision=show_collision)
            compas_frames = robot.transformed_frames(configuration, group)

            if show_visual:
                visual = robot.artist.draw_visual()

            if show_collision:
                collision = robot.artist.draw_collision()

            if show_base_frame:
                base_compas_frame = compas_frames[0]
                artist = FrameArtist(base_compas_frame)
                base_frame = artist.draw()

            if show_end_effector_frame:
                ee_compas_frame = robot.forward_kinematics(configuration, group, options=dict(solver='model'))
                artist = FrameArtist(ee_compas_frame)
                ee_frame = artist.draw()

            if show_frames:
                frames = []
                for compas_frame in compas_frames[1:]:
                    artist = FrameArtist(compas_frame)
                    frame = artist.draw()
                    frames.append(frame)

            if show_acm:
                attached_meshes = []
                for acm in attached_collision_meshes:
                    frame = robot.forward_kinematics(configuration, options=dict(solver='model', link_name=acm.link_name))
                    T = Transformation.from_frame_to_frame(Frame.worldXY(), frame)
                    mesh = acm.collision_mesh.mesh.transformed(T)
                    attached_meshes.append(MeshArtist(mesh).draw())

        return (visual, collision, attached_meshes, frames, base_frame, ee_frame)
# ---------- end robot_visualize ----------

move_to_config = GhPythonScript(config=config, speed=Slider(1, range=0..2), accel=Slider(0.1, range=0..3.14), send=Button(), ip="192.168.0.10")  # -> out, a
# ---------- move_to_config: Python ----------
import os
from compas.rpc import Proxy

if send:
    ghfile = ghenv.Component.OnPingDocument().FilePath
    rtde = Proxy('510_rtde', path=os.path.dirname(ghfile))
    nowait = True
    a = rtde.move_to_joints(config, speed, accel, nowait, ip=ip)
# ---------- end move_to_config ----------

pick_and_place = GhPythonScript(
    approach_pick=ik,
    pick=pickup,
    approach_place=ik_4,
    place=ik_3,
    speed=number_slider_12,
    accel=Slider(1, range=0..3.14),
    send=Button(),
    ip="192.168.0.10")  # -> out, a
# ---------- pick_and_place: Python ----------
import os
import time
from compas.rpc import Proxy

if send:
    ghfile = ghenv.Component.OnPingDocument().FilePath
    rtde = Proxy('510_rtde', path=os.path.dirname(ghfile))

    nowait = False
    signal = 0
    rtde.move_to_joints(approach_pick, speed, accel, nowait, ip=ip)
    rtde.movel_to_joints(pick, speed, accel, nowait, ip=ip)
    rtde.set_digital_io(int(signal), True, ip=ip)
    time.sleep(1)
    rtde.move_to_joints(approach_pick, speed, accel, nowait, ip=ip)

    rtde.move_to_joints(approach_place, speed, accel, nowait, ip=ip)
    rtde.movel_to_joints(place, speed, accel, nowait, ip=ip)
    rtde.set_digital_io(int(signal), False, ip=ip)
    time.sleep(1)
    nowait = True
    rtde.move_to_joints(approach_place, speed, accel, nowait, ip=ip)
# ---------- end pick_and_place ----------
